# Grasshopper definition aula_1.gh (Grasshopper 0.9.76)

# https://www.youtube.com/watch?v=pFCrIzENDn8&list=PLapoQ_9M-ujfYGOsZProIXPGx-HRfjJ9C
# 
# parada 2:21
number_slider = Slider(1, range=0..1)
pt = Point([Point(-1, 6, 0), Point(3.708626603, 6, 0), Point(-1, 1, 0), Point(-2.594904939, -2.829162458, 0), Point(4.158776764, -0.5649164868, 0), Point(1, -5, 0), Point(8.16449831, 2.056537881, 0), Point(5.849678934, -5.983326311, 0)])
pt_2 = Point([Point(5, -17, 0), Point(-9, -13, 0), Point(7, -9, 0), Point(-10, -4, 0), Point(8, -1, 0), Point(-9, 8, 0), Point(7, 7, 0), Point(-4, 14, 0), Point(8, 14, 0)])
c_script = CSharpScript(x=number_slider, y=Slider(2, range=0..2), z=Slider(1, range=0..1))  # -> out, A, B; inputs x: Double, y: Double, z: Double
# ---------- c_script: C# ----------
    //Point3d myPoint = new Point3d(1.0, 2.0, 3.0);
    //A = myPoint;

    //if (x > y)
    //{
    //  Print("x is bigger than y");
    //  Print("y is smaller than x");
    //}
    //else
    //{
    //  Print("x is smaller than y");
    //  Print("y is bigger than x");
    //}

    for (int i = 0; i < 5; i++)
    {
      Print(i.ToString());
      RhinoApp.WriteLine("Hello World"); //imprime no rhino
    }
# ---------- end c_script ----------
c_script_2 = CSharpScript()  # -> out, A
# ---------- c_script_2: C# ----------
    List<Point3d> myPoints = new List<Point3d> ();

    //myPoints.Add(new Point3d(1.0, 2.0, 3.0));
    //myPoints.Add(new Point3d(2.0, 3.0, 4.0));

    for (int i = 0; i < 100; i++)
    {
      Point3d point = new Point3d(i, i, i);
      myPoints.Add(point);
    }

    A = myPoints;
# ---------- end c_script_2 ----------
c_script_3 = CSharpScript()  # -> out, A
# ---------- c_script_3: C# ----------
    List<Point3d> myPoints = new List<Point3d> ();

    //myPoints.Add(new Point3d(1.0, 2.0, 3.0));
    //myPoints.Add(new Point3d(2.0, 3.0, 4.0));

    for (int i = 0; i < 100; i++)
    {
      for (int j = 0; j < 20; j++)
      {
        myPoints.Add(new Point3d(i, j, 0));
      }
    }

    A = myPoints;
# ---------- end c_script_3 ----------
c_script_4 = CSharpScript(points=pt)  # -> out, A; inputs points: list of Point3d
# ---------- c_script_4: C# ----------
    List<Circle> circles = new List<Circle>();

    foreach (Point3d point in points)
    {
      Circle circle = new Circle(point, 2.0);
      circles.Add(circle);
    }
    A = circles;
# ---------- end c_script_4 ----------
c_script_5 = CSharpScript(controlPoints=pt_2, iterationCount=Slider(7, range=0..10))  # -> out, curve; inputs controlPoints: list of Point3d, iterationCount: Int32
# ---------- c_script_5: C# ----------
    for (int j = 0; j < iterationCount; j++)
    {

      List<Point3d> newControlPoints = new List<Point3d>();

      for (int i = 0; i < controlPoints.Count - 1; i++)
      {

        Point3d oneQuarterPoint = 0.75 * controlPoints[i] + 0.25 * controlPoints[i + 1];
        newControlPoints.Add(oneQuarterPoint);

        Point3d threeQuarterPoint = 0.25 * controlPoints[i] + 0.75 * controlPoints[i + 1];
        newControlPoints.Add(threeQuarterPoint);
      }

      controlPoints = newControlPoints;
    }

    curve = new PolylineCurve(controlPoints);
# ---------- end c_script_5 ----------
nurbs = NurbsCurve(Vertices=pt_2, Degree=3, Periodic=False)  # -> Curve, Length, Domain
c_script_6 = CSharpScript()  # -> out, A
# ---------- c_script_6: C# ----------
    //double result = ComputerCylinderVolume(2.0, 2.0);
    //Print(result.ToString());
    Print(ComputerCylinderVolume(2.0, 2.0).ToString());

    Print(ComputerCylinderVolume(4.0, 5.0).ToString());
# ---------- c_script_6: C# additional code ----------
  double ComputerCylinderVolume(double r, double h)
  {
    double baseArea = ComputerCircleArea(double r);
    return baseArea * h;
  }

  double ComputerCircleArea(double r)
  {
    return r * r * 3.14;
  }
# ---------- end c_script_6 ----------
panel = Panel(c_script.out)
panel_2 = Panel(c_script.A)
panel_3 = Panel(c_script_6.out)
